# Grasshopper definition FoodChainOverview.gh (Grasshopper 1.0.7)
# plug-ins: FoodChain

create_scope = CreateScope(Name="myScope")
panel = Panel("URIRef('https://w3id.org/seas/#Property')")
panel_2 = Panel("OWL.AnnotationProperty")
parse_graph = ParseGraph(Scope=create_scope, GraphName="myGraph", URI="https://www.projekt-scope.de/ontologies/omg/omg.ttl")  # -> Scope, Txt
panel_3 = Panel("OWL.Class")
gh_scope = GHScope(parse_graph.Scope)
panel_4 = Panel(parse_graph.Txt)
panel_5 = Panel(gh_scope)
get_subjects = GetSubjects(Scope=gh_scope, GraphName="myGraph", Predicate="RDFS.label")  # -> Scope, Subjects
get_objects = GetObjects(Scope=gh_scope, GraphName="myGraph", Predicate="RDF.type")  # -> Scope, Objects
get_predicates = GetPredicates(Scope=gh_scope, GraphName="myGraph", Object="URIRef('https://w3id.org/omg#Geometry')")  # -> Scope, Predicates
panel_6 = Panel(get_predicates.Predicates)
panel_7 = Panel(get_subjects.Subjects)
panel_8 = Panel(get_objects.Objects)
